# Grasshopper definition algo_2.gh (Grasshopper 1.0.8)
# plug-ins: RhinoCodePluginGH

# ---- group: CENTER
pln = Plane(PlaneXY(0, 0, 0))

# ---- group: sliders of 1.
waves = Slider(15, range=2..15)
height = Slider(50, range=50..100)
angle = Slider(0.4, range=0..0.4)
rotation = Slider(0, range=0..360)

# ---- group: origin of 1.
vec = VectorXYZ(XComponent=Slider(-125, range=-500..500), YComponent=Slider(190, range=-500..500), ZComponent=0)  # -> Vector, Length
pln_2 = Plane(pln)
move = Move(Geometry=pln_2, Motion=vec.Vector)  # -> Geometry, Transform

# ---- group: origin of 2.
vec_2 = VectorXYZ(XComponent=Slider(-125, range=-500..500), YComponent=Slider(0, range=-500..500), ZComponent=0)  # -> Vector, Length
pln_3 = Plane(pln)
move_2 = Move(Geometry=pln_3, Motion=vec_2.Vector)  # -> Geometry, Transform

# ---- group: origin of 3.
vec_3 = VectorXYZ(XComponent=Slider(-125, range=-500..500), YComponent=Slider(-190, range=-500..500), ZComponent=0)  # -> Vector, Length
pln_4 = Plane(pln)
move_3 = Move(Geometry=pln_4, Motion=vec_3.Vector)  # -> Geometry, Transform

# ---- group: sliders of 2.
waves_2 = Slider(8, range=2..15)
height_2 = Slider(75, range=50..100)
angle_2 = Slider(0, range=0..0.4)
rotation_2 = Slider(360, range=0..360)

# ---- group: sliders of 3.
height_3 = Slider(50, range=50..100)
angle_3 = Slider(0, range=0..0.4)
rotation_3 = Slider(0, range=0..360)
waves_3 = Slider(2, range=2..15)

# ---- group: Text options
baking_numbers_on_off = BooleanToggle(False)
text_up_down = Slider(0, range=-200..200)
gen_tex_left_right = Slider(-2, range=-500..200)
gen_text_up_down = Slider(340, range=-200..500)
text_distance_to_gen = Slider(-371, range=-500..200)
gen_distance = Slider(284, range=0..500)

# ----
# Reload/Refresh
reload_evolution = Button()
# Delete latest Generation
delete_evolution = Button()
design_2_voting = Slider(1, range=0..20)
design_3_voting = Slider(0, range=0..20)
# Voting sliders
design_1_voting = Slider(0, range=0..20)
# Bake current Generation
bake_evolution = Button()
# Lock first Generation
lock_gen_0 = Button()

# ---- group: Mutation options
mutation_probability = Slider(0, range=0..100)
mutation_range = Slider(0, range=0..100)

# ----
py3 = Python3Script(trigger=lock_gen_0)  # -> out
# ---------- py3: Python ----------
import Grasshopper as gh

def toggle_visibility():
    doc = gh.Instances.ActiveCanvas.Document
    if doc:
        i = 0
        for obj in doc.Objects:
            i += 1
            if obj.NickName == "generatie0":
                print(str(i) + obj.NickName)
                print("Visibility toggled")
                print(obj.Hidden)
                obj.Hidden = not obj.Hidden
                obj.Attributes.ExpireLayout()
                obj.ExpireSolution(True)

if trigger == False:
    toggle_visibility()
# ---------- end py3 ----------
or = GateOr(A=reload_evolution, B=delete_evolution)
py3_2 = Python3Script(x=delete_evolution)  # -> out, gen0_active
# ---------- py3_2: Python ----------
import os
import rhinoscriptsyntax as rs
import scriptcontext as sc
import Rhino

# Set script to work with Rhino document instead of GH document
sc.doc = Rhino.RhinoDoc.ActiveDoc  

def get_output_directory():
    cwd = rs.WorkingFolder()
    directory = os.path.abspath(os.path.join(cwd, os.pardir))
    directory = os.path.join(directory, "darwinOutput")
    return directory

def check_evolution_iteration():
    i = 1
    file_exists = True
    directory = get_output_directory()
    while file_exists and i < 10:
        filename = os.path.join(directory, f"evolution_{i}")
        if not os.path.exists(filename):
            filename = os.path.join(directory, f"evolution_{i - 1}")
            file_exists = False
        i += 1
    return filename, i - 1

def delete_file(filename):
    try:
        os.remove(filename)
        print(f"{filename} has been deleted successfully.")
    except FileNotFoundError:
        print(f"{filename} does not exist.")
    except PermissionError:
        print(f"Permission denied: {filename}")
    except Exception as e:
        print(f"Error occurred: {e}")

def delete_layer(layer_name):
    if rs.IsLayer(layer_name):
        obj_ids = rs.ObjectsByLayer(layer_name)
        if obj_ids:
            rs.DeleteObjects(obj_ids)  # Delete all objects on the layer
            print(f"Deleted {len(obj_ids)} objects from layer '{layer_name}'.")
        rs.DeleteLayer(layer_name)
        print("Layer " + layer_name + " deleted!")
    else:
        print("Layer " + layer_name + " does not exist.")
        gen0_active = "gen0_active"
        bool_true = True
        exec(f"global {str(gen0_active)}; {str(gen0_active)} = bool_true")
        if layer_name == "0" and rs.IsLayer("0"):
            layer_name = "0"
            obj_ids = rs.ObjectsByLayer(layer_name)
            if obj_ids:
                rs.DeleteObjects(obj_ids)  # Delete all objects on the layer
                print(f"Deleted {len(obj_ids)} objects from layer '{layer_name}'.")
            rs.DeleteLayer(layer_name)
            print("Layer " + layer_name + " deleted!")
            
            


def delete_evolution():
    filename, i = check_evolution_iteration()
    delete_file(filename)
    delete_layer(str(i - 1))
    print("Deleted evolution file and corresponding layer.")

if (x == True):
    delete_evolution()
else:
    print("False")

sc.doc = ghdoc
# ---------- end py3_2 ----------
py3_3 = Python3Script(trigger=py3_2.gen0_active)  # -> out
# ---------- py3_3: Python ----------
import Grasshopper as gh

def toggle_visibility():
    doc = gh.Instances.ActiveCanvas.Document
    if doc:
        i = 0
        for obj in doc.Objects:
            i += 1
            if obj.NickName == "generatie0":
                print(str(i) + obj.NickName)
                print("Visibility toggled")
                print(obj.Hidden)
                obj.Hidden = False
                obj.Attributes.ExpireLayout()
                obj.ExpireSolution(True)

if (trigger == True):
    toggle_visibility()
# ---------- end py3_3 ----------

# ---- group: Silder/file extraction script
py3_4 = Python3Script(
    v=or,
    x=[waves, waves_2, waves_3],
    y=[height, height_2, height_3],
    z=[angle, angle_2, angle_3],
    u=[rotation, rotation_2, rotation_3])  # -> out, a, b, c, d
# ---------- py3_4: Python ----------
# Requirements: clr
import Rhino
import json
import clr
import os
import rhinoscriptsyntax as rs
import scriptcontext as sc
import time


# Add references for .NET namespaces
# needed to convert System.Decimal to float
clr.AddReference("System")
clr.AddReference("System.Globalization")
from System import Decimal
from System.Globalization import CultureInfo


# Initialize a list to hold dictionaries for each run
sliders_data_runs = []
child = []

# Iterate through all input parameters
def extract_sliders():
    max_sources = 0  # Determine the max number of sources across all inputs

    # First pass: Find the maximum number of input sources available
    for input_param in ghenv.Component.Params.Input:
        max_sources = max(max_sources, len(input_param.Sources))

    # Initialize dictionaries for each run dynamically
    for _ in range(max_sources):
        sliders_data_runs.append({})  # Create an empty dictionary for each run

    # Second pass: Extract slider data for each source index
    for idx, input_param in enumerate(ghenv.Component.Params.Input):
        for source_index in range(len(input_param.Sources)):
            slider = input_param.Sources[source_index]
            if slider.Name != "Number Slider":
                continue

            # Convert System.Decimal to Python float using .NET's ToDouble() method
            Min = Decimal.ToDouble(slider.Slider.Minimum)
            Max = Decimal.ToDouble(slider.Slider.Maximum)
            Value = Decimal.ToDouble(slider.Slider.Value)

            precision = slider.Slider.DecimalPlaces
            Step_size = 10 ** -precision
            Range = (Max - Min) / Step_size if Step_size > 0 else 0

            slider_key = f"Slider_{idx - 1}"
            sliders_data_runs[source_index][slider_key] = {
                "Value": Value,
                "Min": Min,
                "Max": Max,
                "Step Size": Step_size,
                "Range": Range
            }

def get_output_directory():
    cwd = rs.WorkingFolder()
    directory = os.path.abspath(os.path.join(cwd, os.pardir))
    directory =  os.path.join(directory, "darwinOutput")
    return directory

def check_directory():
    directory = get_output_directory()
    if ( not os.path.isdir(directory)):
        return False
    return True

def check_evolution_iteration():
    i = 1
    file_exists = False
    directory = get_output_directory()
    while (i < 10):
        filename = os.path.join(directory, "evolution_" + str(i))
        if ( os.path.exists(filename)):
            file_exists = True
        i += 1
    return (file_exists)

def file_exists():
    if (not check_directory()):
        return False
    if (not check_evolution_iteration()):
        return False
    return True

# def create_output():
#     for i, value in enumerate(child):
#         exec(f"{chr(97 + i)} = {value}")

def get_filename():
    i = 1
    file_exists = False
    directory = get_output_directory()
    while (i < 10):
        filename = os.path.join(directory, "evolution_" + str(i))
        if ( not os.path.exists(filename)):
            break;
        prev_filename = filename
        i += 1
    evo_num = prev_filename.split('_', 1)[1]
    out_name = "evo_num"
    globals()['evo_num'] = evo_num
    return (prev_filename)

def extract_file():
    filename = get_filename()
    with open(filename, 'r') as file:
        content = file.read()
        return content

def json_file_to_output(file_data):
    data = json.loads(file_data)  # Load JSON string into Python object (list of dicts)
    for run_idx, run_data in enumerate(data):  # Iterate over each run (dictionary)
        # print(str(sc.sticky["run_count1"]) + " " + str(run_idx))
        if sc.sticky["run_count1"] == run_idx:
            for i, (key, slider_data) in enumerate(run_data.items()):  # Iterate through sliders
                value = slider_data["Value"]
                # print(chr(97 + i) + str(value))
                exec(f"global {chr(97 + i)}; {chr(97 + i)} = value")



if "run_count1" not in sc.sticky:
    sc.sticky["run_count1"] = -1
if len(ghenv.Component.Params.Input[1].Sources) - 1 <= sc.sticky["run_count1"]:
        sc.sticky["run_count1"] = -1

# print (str(len(ghenv.Component.Params.Input[0].Sources) - 1) + " " + str(sc.sticky["run_count1"]))
# sc.sticky["run_count1"] = -1
sc.sticky["run_count1"] += 1
# print (str(len(ghenv.Component.Params.Input[0].Sources) - 1) + " " + str(sc.sticky["run_count1"]))

if (file_exists()):
    extract_file_data = extract_file()
    # print (extract_file_data)
    data = json.loads(extract_file_data)
    sliders_data_runs = [entry for entry in data]
    # print(sliders_data_runs[0])
    json_file_to_output(extract_file_data)
else:
    extract_sliders()
    # Convert the list of dictionaries to JSON
    sliders_data_json = json.dumps(sliders_data_runs, separators=(", ", ":"))
    json_file_to_output(sliders_data_json)


sliders_data_runs_len = 0
for i in sliders_data_runs:
    sliders_data_runs_len += 1

if 0 <= sc.sticky["run_count1"] < sliders_data_runs_len:
    run = sliders_data_runs[sc.sticky["run_count1"]]
    print(json.dumps(run, separators=(", ", ":")))


if len(ghenv.Component.Params.Input[1].Sources) - 1 <= sc.sticky["run_count1"]:
        sc.sticky["run_count1"] = -1
# ---------- end py3_4 ----------

# ----
graft = GraftTree(Tree=py3_4.d, IncludeEmptyLists=True, IncludeNullItems=True)
graft_2 = GraftTree(Tree=[move.Geometry, move_2.Geometry, move_3.Geometry], IncludeEmptyLists=True, IncludeNullItems=True)
graft_3 = GraftTree(Tree=py3_4.c, IncludeEmptyLists=True, IncludeNullItems=True)
graft_4 = GraftTree(Tree=py3_4.b, IncludeEmptyLists=True, IncludeNullItems=True)
graft_5 = GraftTree(Tree=py3_4.a, IncludeEmptyLists=True, IncludeNullItems=True)

# ---- group: building gene pool
bang = ExplodeTree(Data=py3_4.out)  # -> Branch0, Branch1, Branch2
dup = DuplicateData(Data=bang.Branch0, Number=design_1_voting, Order=True)
dup_2 = DuplicateData(Data=bang.Branch2, Number=design_3_voting, Order=True)
dup_3 = DuplicateData(Data=bang.Branch1, Number=design_2_voting, Order=True)
weave = Weave(Pattern=[0, 1], Stream0=dup, Stream1=dup_3, NullGaps=False)
weave_2 = Weave(Pattern=[0, 1], Stream0=weave, Stream1=dup_2, NullGaps=False)

# ----
generatie0 = Generatie0(pln=graft_2, num=graft_5, relay=graft_4, relay_2=graft_3, relay_3=graft)  # -> brep_3, brep_4

# ---- group: Baking function for Gen0
layer = ModelLayer(Name="0", DisplayColour=ColourSwatch(SwatchColor=RGB(0, 214, 127)))  # -> Layer, Name, Hidden, Locked, DisplayColour, Material, Linetype
object = ModelObject(Geometry=generatie0.brep_4, Layer=layer.Layer)  # -> Object, Geometry, Name, Layer, Visibility, Display, Drafting, Render
cache = ContentCache(Content=object.Object, Trigger=lock_gen_0, Action=2)

# ----
panel = Panel(weave_2)
flatten = FlattenTree(Tree=py3_4.out, Path="{0}")

# ---- group: selecting parent pool
lng = ListLength(List=panel)
lng_2 = ListLength(List=flatten)
multiplication = Multiplication(A=lng_2, B="2")
smaller = SmallerThan(FirstNumber=lng, SecondNumber=multiplication)  # -> SmallerThan, OrEqualTo
dup_4 = DuplicateData(Data=panel, Number=multiplication, Order=True)
filter = StreamFilter(Gate=smaller.SmallerThan, Stream0=panel, Stream1=dup_4)
lng_3 = ListLength(List=filter)
subtraction = Subtraction(A=lng_3, B=multiplication)
py3_5 = Python3Script(x=lng_3)  # -> out
# ---------- py3_5: Python ----------
import random

r = random.randint(0, x)
print(r)
# ---------- end py3_5 ----------
abs = Absolute(Value=subtraction)
reduce = RandomReduce(List=filter, Reduction=abs, Seed=py3_5)

# ---- group: dynamic move for gen
py3_6 = Python3Script(x=or)  # -> out
# ---------- py3_6: Python ----------
import os
import rhinoscriptsyntax as rs

def get_output_directory():
    cwd = rs.WorkingFolder()
    directory = os.path.abspath(os.path.join(cwd, os.pardir))
    directory =  os.path.join(directory, "darwinOutput")
    return directory

def check_directory():
    directory = get_output_directory()
    if ( not os.path.isdir(directory)):
        return (1)

def check_evolution_iteration():
    i = 1
    file_exists = True
    directory = get_output_directory()
    while (file_exists and i < 10):
        filename =  os.path.join(directory, "evolution_" + str(i))
        if ( not os.path.exists(filename)):
            return (i - 1)
        i += 1
    return (11)

if (check_directory()):
    print ("0")
else:
    print(check_evolution_iteration())
# ---------- end py3_6 ----------
addition = Addition(A=py3_6, B="1")
multiplication_2 = Multiplication(A=addition, B=gen_distance)
vec_4 = VectorXYZ(XComponent=multiplication_2, YComponent=0, ZComponent=0)  # -> Vector, Length
move_4 = Move(Geometry=[move.Geometry, move_2.Geometry, move_3.Geometry], Motion=vec_4.Vector)  # -> Geometry, Transform
graft_6 = GraftTree(Tree=move_4.Geometry, IncludeEmptyLists=True, IncludeNullItems=True)

# ---- group: dynamic lables
py3_7 = Python3Script(x=or)  # -> out; same code as py3_6
pln_5 = Plane(pln)
multiplication_3 = Multiplication(A=py3_7, B=gen_distance)
addition_2 = Addition(A=multiplication_3, B=text_distance_to_gen)
vec_5 = VectorXYZ(XComponent=gen_tex_left_right, YComponent=gen_text_up_down, ZComponent=0)  # -> Vector, Length
vec_6 = VectorXYZ(XComponent=addition_2, YComponent=text_up_down, ZComponent=0)  # -> Vector, Length
move_5 = Move(Geometry=pln_5, Motion=vec_5.Vector)  # -> Geometry, Transform
move_6 = Move(Geometry=[move.Geometry, move_2.Geometry, move_3.Geometry, move_5.Geometry], Motion=vec_6.Vector)  # -> Geometry, Transform
addition_3 = Addition(A=py3_7, B="1")
concat = Concatenate(FragmentA=addition_3, FragmentB=". Gen")
concat_2 = Concatenate(FragmentA=py3_7, FragmentB=". Gen")
vec_7 = VectorXYZ(XComponent="500", YComponent=0, ZComponent=0)  # -> Vector, Length
flatten_2 = FlattenTree(Tree=concat, Path="{0}")
flatten_3 = FlattenTree(Tree=concat_2, Path="{0}")
move_7 = Move(Geometry=move_6.Geometry, Motion=vec_7.Vector)  # -> Geometry, Transform
vec_8 = VectorXYZ(XComponent=gen_distance, YComponent=0, ZComponent=0)  # -> Vector, Length
ln = Line(StartPoint=move_6.Geometry, EndPoint=move_7.Geometry)
move_8 = Move(Geometry=ln, Motion=vec_8.Vector)  # -> Geometry, Transform
depth = Slider(8, range=0..200)
hight = Slider(45, range=0..200)
planesrf = PlaneSurface(Plane=PlaneXY(0, 0, 0), XSize=Domain(-10, 10), YSize=Domain(-10, 10))
textsrf = TextOnSurface(
    Text=["1.", "2.", "3.", flatten_3, "1.", "2.", "3.", flatten_2],
    Font="Sans Bold:no Italic:no",
    Height=hight,
    Depth=depth,
    BaseLine=[ln, move_8.Geometry],
    BaseSurface=planesrf)
and = GateAnd(A=bake_evolution, B=baking_numbers_on_off)

# ---- group: creating data structure for evolution
toggle = BooleanToggle(True)
toggle_2 = BooleanToggle(False)
cull = CullPattern(List=reduce, CullPattern=[toggle, toggle_2])
cull_2 = CullPattern(List=reduce, CullPattern=[toggle_2, toggle])

# ---- group: creating data structure for evolution / fixing json structure
concat_3 = Concatenate(FragmentA=cull, FragmentB=", ")
concat_4 = Concatenate(FragmentA=concat_3, FragmentB=cull_2)
concat_5 = Concatenate(FragmentA=concat_4, FragmentB="]")
concat_6 = Concatenate(FragmentA="[", FragmentB=concat_5)

# ---- group: creating data structure for evolution (continued)
partition = PartitionList(List=concat_6, Size="1")

# ----
panel_2 = Panel(partition)
py3_8 = Python3Script(parents=partition, mutation_probability=mutation_probability, mutation_range=mutation_range)  # -> out, a, b, c, d
# ---------- py3_8: Python ----------
import random
import json
import rhinoscriptsyntax as rs
import scriptcontext as sc
import Rhino
import Grasshopper

parent_data = []
child = []
child_data = []

def getInputData():
    max_sources = 0
    for input_param in ghenv.Component.Params.Input:
        max_sources = max(max_sources, len(input_param.Sources))

    # for _ in range(max_sources):
    #     parent_data_runs.append({})

    input_param = ghenv.Component.Params.Input[0]
    if input_param.Sources and input_param.Sources[0]:
        value = input_param.Sources[0].VolatileData
        for idx, path in enumerate(value.Paths):
            if idx == sc.sticky["run_count2"]:
                parents = value.get_Branch(path)
                raw_json = str(parents[0])
                parent_data = json.loads(str(parents[0]))
                return parent_data


def creategen(parent_data):
    global child, child_data
    child = []
    child_data = {}

    for i in range(len(parent_data[0])):
        key = f"Slider_{i}"
        
        slider_data = parent_data[0].get(key, {})
        if not slider_data:
            continue

        min1 = slider_data["Min"]
        max1 = slider_data["Max"]
        step_size1 = slider_data["Step Size"]
        range1 = slider_data["Range"]

        value = parent_data[0][key]["Value"] if random.choice([True, False]) else parent_data[1][key]["Value"]

        if random.random() < mutation_probability / 100 and mutation_range:
            deviation_steps = (range1 / 100) * random.randint(1, mutation_range)
            deviation = round(deviation_steps) * step_size1
            value = value + deviation if random.choice([True, False]) else value - deviation
        
        value = max(min(value, max1), min1)
        
        child.append(str(value))
        child_data[f"Slider_{i}"] = {
            "Value": value,
            "Min": min1,
            "Max": max1,
            "Step Size": step_size1,
            "Range": range1
        }




if "run_count2" not in sc.sticky:
    sc.sticky["run_count2"] = -1
if len(ghenv.Component.Params.Input) - 1 <= sc.sticky["run_count2"]:
        sc.sticky["run_count2"] = -1
# print (str(len(ghenv.Component.Params.Input) - 1) + " " + str(sc.sticky["run_count2"]))
# sc.sticky["run_count2"] = -1
sc.sticky["run_count2"] += 1
# print (str(len(ghenv.Component.Params.Input) - 1) + " " + str(sc.sticky["run_count2"]))


parent_data = getInputData()
creategen(parent_data)
# print(parent_data)

for i, value in enumerate(child):
    exec(f"{chr(97 + i)} = {value}")

# print(sc.sticky["run_count2"])
print(json.dumps(child_data, separators=(", ", ":")))


if len(ghenv.Component.Params.Input) - 1 <= sc.sticky["run_count2"]:
        sc.sticky["run_count2"] = -1
# ---------- end py3_8 ----------
panel_3 = Panel(py3_8.out)
evos = Generatie0(pln=graft_6, num=py3_8.a, relay=py3_8.b, relay_2=py3_8.c, relay_3=py3_8.d)  # -> brep_3, brep_4

# ---- group: save json data in file
flatten_4 = FlattenTree(Tree=py3_8.out, Path="{0}")
py3_9 = Python3Script(parents=flatten_4, trigger=bake_evolution)  # -> out
# ---------- py3_9: Python ----------
import os
import rhinoscriptsyntax as rs
import json
import scriptcontext as sc
import time

def get_output_directory():
    cwd = rs.WorkingFolder()
    directory = os.path.abspath(os.path.join(cwd, os.pardir))
    directory =  os.path.join(directory, "darwinOutput")
    return directory

def create_directory(directory):
    try:
        os.mkdir(directory)
    except FileExistsError:
        print(f"Directory '{directory}' already exists.")
    except PermissionError:
        print(f"Permission denied: unable to create '{directory}'")
    except Exception as e:
        print(f"An error occurred: {e}")

def check_directory():
    directory = get_output_directory()
    if ( not os.path.isdir(directory)):
        create_directory(directory)

def create_evolution_file(filename):
    f = open(filename, "x")
    f.close()

def check_evolution_iteration():
    i = 1
    file_exists = True
    directory = get_output_directory()
    while (file_exists and i < 10):
        filename =  os.path.join(directory, "evolution_" + str(i))
        if ( not os.path.exists(filename)):
            create_evolution_file(filename)
            file_exists = False
        i += 1
    return (filename)
    

def save_to_file(filename):
    f = open(filename, "w")
    input_param = ghenv.Component.Params.Input[0]
    values = []
    if input_param.Sources:
        for source in input_param.Sources:
            data_tree = source.VolatileData
            values.extend(json.loads(str(v)) for v in data_tree.AllData(True))
    json.dump(values, f)
    f.close()
    return json.dumps(values)

def save_evolution():
   filename = check_evolution_iteration()
   str_file = save_to_file(filename)
   print("saved")
   return str_file


max_values = 0
for input_param in ghenv.Component.Params.Input:
    if input_param.Sources:
        value_tree = input_param.Sources[0].VolatileData
        num_values = sum(len(value_tree.get_Branch(path)) for path in value_tree.Paths)
        max_values = max(max_values, num_values)
if "run_count3" not in sc.sticky:
    sc.sticky["run_count3"] = -1
if "last_json_export" not in sc.sticky:
    sc.sticky["last_json_export"] = ""
if max_values - 1 <= sc.sticky["run_count3"]:
        sc.sticky["run_count3"] = -1

# print (str(max_values - 1) + " " + str(sc.sticky["run_count3"]))
# sc.sticky["run_count3"] = -1
sc.sticky["run_count3"] += 1
# print (str(max_values - 1) + " " + str(sc.sticky["run_count3"]))



if (trigger == True and sc.sticky["run_count3"] == 0):
    check_directory()
    sc.sticky["last_json_export"] = save_evolution()
elif (sc.sticky["run_count3"] == 0):
    print("Last saved export:\n" + str(sc.sticky["last_json_export"]))


if max_values - 1 <= sc.sticky["run_count3"]:
        sc.sticky["run_count3"] = -1
# ---------- end py3_9 ----------

# ---- group: bake current gen in correct layer / layer
py3_10 = Python3Script(x=or)  # -> out; same code as py3_6

# ----
addition_4 = Addition(A=py3_10, B="1")

# ---- group: bake current gen in correct layer / layer (continued)
layer_2 = ModelLayer(Name=addition_4, DisplayColour=ColourSwatch(SwatchColor=RGB(0, 214, 127)))  # -> Layer, Name, Hidden, Locked, DisplayColour, Material, Linetype

# ---- group: dynamic lables (continued)
object_2 = ModelObject(Geometry=textsrf, Layer=layer_2.Layer)  # -> Object, Geometry, Name, Layer, Visibility, Display, Drafting, Render
cache_2 = ContentCache(Content=object_2.Object, Trigger=and, Action=2)

# ---- group: bake current gen in correct layer / bake
object_3 = ModelObject(Geometry=evos.brep_4, Layer=layer_2.Layer)  # -> Object, Geometry, Name, Layer, Visibility, Display, Drafting, Render
cache_3 = ContentCache(Content=object_3.Object, Trigger=bake_evolution, Action=2)

# ==== cluster Generatie0
pln = ClusterInput()
pln_2 = Plane(pln)
num = ClusterInput()
num_2 = Number(num)
relay = ClusterInput()
relay_2 = ClusterInput()
relay_3 = ClusterInput()

# ----
# base conture
ground_radius = Panel("30")
ground_inner_radius = Panel("4")
cir = Circle(Plane=pln_2, Radius=ground_radius)
ground_inner_radius_2 = Panel("2")
multiplication = Multiplication(A=ground_inner_radius_2, B=num_2)
divide = DivideCurve(Curve=cir, Count=num_2, Kinks=False)  # -> Points, Tangents, Parameters
pt = Point(divide.Points)

subtraction = Subtraction(A=ground_radius, B=ground_inner_radius)

cir_2 = Circle(Plane=pln_2, Radius=subtraction)
divide_2 = DivideCurve(Curve=cir_2, Count=multiplication, Kinks=False)  # -> Points, Tangents, Parameters
dispatch = Dispatch(List=divide_2.Points, DispatchPattern=[True, False])  # -> ListA, ListB
pt_2 = Point(dispatch.ListB)
weave = Weave(Pattern=[0, 1], Stream0=pt, Stream1=pt_2, NullGaps=False)
pline = PolyLine(Vertices=weave, Closed=invert(False))

# ----
# Model height
ground_inner_radius_3 = Panel("5")
range = Range(Domain=Domain(0, 1), Steps=ground_inner_radius_3)
multiplication_2 = Multiplication(A=range, B=relay)
Z = UnitZ(Factor=multiplication_2)
move = Move(Geometry=pline, Motion=Z)  # -> Geometry, Transform

# ----
# angle
area = Area(Geometry=move.Geometry)  # -> Area, Centroid
lng = ListLength(List=move.Geometry)
series = Series(Start=1, Step=relay_2, Count=lng)
scale = Scale(Geometry=move.Geometry, Center=area.Centroid, Factor=series)  # -> Geometry, Transform

# ----
# Rotation
range_2 = Range(Domain=Domain(0, 1), Steps=ground_inner_radius_3)
multiplication_3 = Multiplication(A=range_2, B=relay_3)
rotate = Rotate(Geometry=scale.Geometry, Angle=degrees(multiplication_3), Plane=pln_2)  # -> Geometry, Transform

loft = Loft(Curves=rotate.Geometry, Options={Adjust=False, Closed=False, LoftEnds=0, LoftSimp=0, LoftType=0, Rebuild=10, Refit=0.01})

# ----
# model for 3D printing
cap = CapHoles(Brep=loft)
brep = Brep(cap)

# ----
# visual model
swatch = ColourSwatch(SwatchColor=RGB(0, 158, 127))
brep_2 = Brep(loft)
preview = CustomPreview(Geometry=brep_2, Material=swatch)

brep_3 = ClusterOutput(brep)
brep_4 = ClusterOutput(brep_2)
