# Grasshopper definition Import_for_printing.gh (Grasshopper 1.0.8)
# plug-ins: RhinoCodePluginGH

# ---- group: Edit sliders after loading
height = Slider(50, range=50..100)
angle = Slider(0, range=0..1)
rotation = Slider(0, range=0..360)
waves = Slider(2, range=2..15)
pln = Plane(PlaneXY(0, 0, 0))

# ---- group: Click button to load file into sliders
load_file = Button()
py3 = Python3Script(trigger=load_file)  # -> out
# ---------- py3: Python ----------
import Rhino
import json
import clr
import os
import rhinoscriptsyntax as rs
import scriptcontext as sc
import time
import Grasshopper as gh
import System

clr.AddReference("System")
clr.AddReference("System.Globalization")
from System import Decimal
from System.Globalization import CultureInfo

sliders_data_runs = []
child = []

def set_slider_value(new_values):
    doc = gh.Instances.ActiveCanvas.Document
    slider_index = 0
    for obj in doc.Objects:
        if isinstance(obj, gh.Kernel.Special.GH_NumberSlider):
            print(str(obj.NickName))
            obj.Slider.Value = System.Decimal(new_values[slider_index])
            obj.ExpireSolution(True)
            slider_index += 1


def setSliders(slider_values):  
    for value in slider_values:
        print (value)

def extract_sliders():
    max_sources = 0
    for input_param in ghenv.Component.Params.Input:
        max_sources = max(max_sources, len(input_param.Sources))
    for _ in range(max_sources):
        sliders_data_runs.append({})

    for idx, input_param in enumerate(ghenv.Component.Params.Input):
        for source_index in range(len(input_param.Sources)):
            slider = input_param.Sources[source_index]
            if slider.Name != "Number Slider":
                continue

            Min = Decimal.ToDouble(slider.Slider.Minimum)
            Max = Decimal.ToDouble(slider.Slider.Maximum)
            Value = Decimal.ToDouble(slider.Slider.Value)

            precision = slider.Slider.DecimalPlaces
            Step_size = 10 ** -precision
            Range = (Max - Min) / Step_size if Step_size > 0 else 0

            slider_key = f"Slider_{idx - 1}"
            sliders_data_runs[source_index][slider_key] = {
                "Value": Value,
                "Min": Min,
                "Max": Max,
                "Step Size": Step_size,
                "Range": Range
            }

def get_output_directory():
    cwd = rs.WorkingFolder()
    directory = os.path.abspath(os.path.join(cwd, os.pardir))
    directory =  os.path.join(directory, "darwinOutput")
    return directory

def check_directory():
    directory = get_output_directory()
    if ( not os.path.isdir(directory)):
        return False
    return True

def check_evolution_iteration():
    i = 1
    file_exists = False
    directory = get_output_directory()
    while (i < 10):
        filename = os.path.join(directory, "evolution_" + str(i))
        if ( os.path.exists(filename)):
            file_exists = True
        i += 1
    return (file_exists)

def file_exists():
    if (not check_directory()):
        return False
    if (not check_evolution_iteration()):
        return False
    return True


def get_filename():
    i = 1
    file_exists = False
    directory = get_output_directory()
    while (i < 10):
        filename = os.path.join(directory, "evolution_" + str(i))
        if ( not os.path.exists(filename)):
            break;
        prev_filename = filename
        i += 1
    evo_num = prev_filename.split('_', 1)[1]
    out_name = "evo_num"
    globals()['evo_num'] = evo_num
    return (prev_filename)

def extract_file():
    filename = get_filename()
    with open(filename, 'r') as file:
        content = file.read()
        return content

def json_file_to_output(file_data):
    data = json.loads(file_data)  # Load JSON string into Python object (list of dicts)
    for run_idx, run_data in enumerate(data):  # Iterate over each run (dictionary)
        # print(str(sc.sticky["run_count1"]) + " " + str(run_idx))
        if sc.sticky["run_count1"] == run_idx:
            for i, (key, slider_data) in enumerate(run_data.items()):  # Iterate through sliders
                value = slider_data["Value"]
                # print(chr(97 + i) + str(value))
                exec(f"global {chr(97 + i)}; {chr(97 + i)} = value")


if (trigger == True):
    if file_exists() == False: 
        print("Missing file")
    else:
        extract_file_data = extract_file()
        data = json.loads(extract_file_data)
        sliders_data_runs = [entry for entry in data]
        values_list = [slider_data['Value'] for slider_data in sliders_data_runs[0].values()]
        print(values_list)
        set_slider_value(values_list)
else:
    if file_exists() == False: 
        print("Missing file")
    else:
        extract_file_data = extract_file()
        data = json.loads(extract_file_data)
        sliders_data_runs = [entry for entry in data]
        values_list = [slider_data['Value'] for slider_data in sliders_data_runs[0].values()]
        print(values_list)
        print(extract_file_data)
# ---------- end py3 ----------
panel = Panel(py3)

# ----
generatie0 = Generatie0(pln=pln, num=waves, relay=height, relay_2=angle, relay_3=rotation)  # -> brep_3, brep_4

# ---- group: bake this brep for printing
brep = Brep(generatie0.brep_3)

# ==== cluster Generatie0
pln = ClusterInput()
pln_2 = Plane(pln)
num = ClusterInput()
num_2 = Number(num)
relay = ClusterInput()
relay_2 = ClusterInput()
relay_3 = ClusterInput()

# ----
# base conture
ground_radius = Panel("30")
ground_inner_radius = Panel("4")
cir = Circle(Plane=pln_2, Radius=ground_radius)
ground_inner_radius_2 = Panel("2")
multiplication = Multiplication(A=ground_inner_radius_2, B=num_2)
divide = DivideCurve(Curve=cir, Count=num_2, Kinks=False)  # -> Points, Tangents, Parameters
pt = Point(divide.Points)

subtraction = Subtraction(A=ground_radius, B=ground_inner_radius)

cir_2 = Circle(Plane=pln_2, Radius=subtraction)
divide_2 = DivideCurve(Curve=cir_2, Count=multiplication, Kinks=False)  # -> Points, Tangents, Parameters
dispatch = Dispatch(List=divide_2.Points, DispatchPattern=[True, False])  # -> ListA, ListB
pt_2 = Point(dispatch.ListB)
weave = Weave(Pattern=[0, 1], Stream0=pt, Stream1=pt_2, NullGaps=False)
pline = PolyLine(Vertices=weave, Closed=invert(False))

# ----
# Model height
ground_inner_radius_3 = Panel("5")
range = Range(Domain=Domain(0, 1), Steps=ground_inner_radius_3)
multiplication_2 = Multiplication(A=range, B=relay)
Z = UnitZ(Factor=multiplication_2)
move = Move(Geometry=pline, Motion=Z)  # -> Geometry, Transform

# ----
# angle
area = Area(Geometry=move.Geometry)  # -> Area, Centroid
lng = ListLength(List=move.Geometry)
series = Series(Start=1, Step=relay_2, Count=lng)
scale = Scale(Geometry=move.Geometry, Center=area.Centroid, Factor=series)  # -> Geometry, Transform

# ----
# Rotation
range_2 = Range(Domain=Domain(0, 1), Steps=ground_inner_radius_3)
multiplication_3 = Multiplication(A=range_2, B=relay_3)
rotate = Rotate(Geometry=scale.Geometry, Angle=degrees(multiplication_3), Plane=pln_2)  # -> Geometry, Transform

loft = Loft(Curves=rotate.Geometry, Options={Adjust=False, Closed=False, LoftEnds=0, LoftSimp=0, LoftType=0, Rebuild=10, Refit=0.01})

# ----
# model for 3D printing
cap = CapHoles(Brep=loft)
brep = Brep(cap)

# ----
# visual model
swatch = ColourSwatch(SwatchColor=RGB(0, 158, 127))
brep_2 = Brep(loft)
preview = CustomPreview(Geometry=brep_2, Material=swatch)

brep_3 = ClusterOutput(brep)
brep_4 = ClusterOutput(brep_2)
