# Grasshopper definition add_material_layer.gh (Grasshopper 1.0.7)

# add material to layer
python = GhPythonScript(color=Slider(83, range=0..255))  # inputs color: Int32
# ---------- python: Python ----------
import rhinoscriptsyntax as rs
import Rhino
import scriptcontext as sc

sc.doc = Rhino.RhinoDoc.ActiveDoc

layer = rs.CurrentLayer()
index = rs.AddMaterialToLayer(layer)
rs.MaterialColor(index, (color, 2, 191))
#rs.MaterialTexture(index, filename)
#rs.MaterialBump(index, filename)

sc.doc = ghdoc
# ---------- end python ----------
