# Grasshopper definition flowerpot design 2.gh (Grasshopper 1.0.8)

rotation = Slider(115, range=0..360)
waves = Slider(15, range=2..15)
height = Slider(64, range=50..100)
angle = Slider(0.238, range=0..0.4)
depth_of_wave = Slider(0, range=0..10)

# ----
# base conture
ground_radius = Panel("30")
ground_inner_radius = Panel("4")
cir = Circle(Plane=PlaneXY(0, 0, 0), Radius=ground_radius)
ground_inner_radius_2 = Panel("2")
multiplication = Multiplication(A=ground_inner_radius_2, B=waves)
divide = DivideCurve(Curve=cir, Count=waves, Kinks=False)  # -> Points, Tangents, Parameters
pt = Point(divide.Points)

subtraction = Subtraction(A=ground_radius, B=ground_inner_radius)

cir_2 = Circle(Plane=PlaneXY(0, 0, 0), Radius=subtraction)
divide_2 = DivideCurve(Curve=cir_2, Count=multiplication, Kinks=False)  # -> Points, Tangents, Parameters
dispatch = Dispatch(List=divide_2.Points, DispatchPattern=[True, False])  # -> ListA, ListB
pt_2 = Point(dispatch.ListB)
weave = Weave(Pattern=[0, 1], Stream0=pt, Stream1=pt_2, NullGaps=False)
pline = PolyLine(Vertices=weave, Closed=invert(False))

# ----
# Model height
ground_inner_radius_3 = Panel("5")
range = Range(Domain=Domain(0, 1), Steps=ground_inner_radius_3)
multiplication_2 = Multiplication(A=range, B=height)
Z = UnitZ(Factor=multiplication_2)
move = Move(Geometry=pline, Motion=Z)  # -> Geometry, Transform

# ----
# angle
area = Area(Geometry=move.Geometry)  # -> Area, Centroid
lng = ListLength(List=move.Geometry)
series = Series(Start=1, Step=angle, Count=lng)
scale = Scale(Geometry=move.Geometry, Center=area.Centroid, Factor=series)  # -> Geometry, Transform

# ----
# Rotation
range_2 = Range(Domain=Domain(0, 1), Steps=ground_inner_radius_3)
multiplication_3 = Multiplication(A=range_2, B=rotation)
rotate = Rotate(Geometry=scale.Geometry, Angle=degrees(multiplication_3), Plane=PlaneXY(0, 0, 0))  # -> Geometry, Transform

loft = Loft(Curves=rotate.Geometry, Options={Adjust=False, Closed=False, LoftEnds=0, LoftSimp=0, LoftType=0, Rebuild=10, Refit=0.01})

# ----
# model for 3D printing
cap = CapHoles(Brep=loft)
brep = Brep(cap)

# ----
# visual model
swatch = ColourSwatch(SwatchColor=RGB(0, 158, 127))
brep_2 = Brep(loft)
preview = CustomPreview(Geometry=brep_2, Material=swatch)
