# Grasshopper definition grasshopper_input.gh (Grasshopper 1.0.8)
# plug-ins: RhinoCodePluginGH

py3 = Python3Script()  # -> out, a
# ---------- py3: Python ----------
# Specify the path to your file
file_path = "C:\\Users\\noitc\\Documents\\darwinprint\\src\\interface\\output\\votes.json"

# Open the file in read mode
with open(file_path, 'r') as file:
    # Read the contents of the file
    content = file.read()

# Print the content
print(content)
# ---------- end py3 ----------
panel = Panel(py3.out)
