# Grasshopper definition flowerpot_design.gh (Grasshopper 1.0.8)

twist_angle = Slider(29, range=0..45)
ground_radius = Panel("30")
floor_thickness = Panel("3")
angle = Slider(2.25, range=1..2.25)
hight = Panel("75")
xy = XYPlane(Origin=Point(0, 0, 0))
twist_angle_2 = Slider(0, range=0..120)
ground_radius_2 = Panel("40")
floor_thickness_2 = Panel("3")
angle_2 = Slider(2.25, range=1..2.25)
hight_2 = Panel("100")
star_component = StarKim(P=PlaneXY(0, 0, 0), inner_radius=Slider(19, range=15..30))
blob_radius = Panel("5")
pt = ConstructPoint(XCoordinate=ground_radius_2, YCoordinate=0, ZCoordinate=0)
Z = UnitZ(Factor=floor_thickness)
polygon = Polygon(Plane=PlaneXY(0, 0, 0), Radius=ground_radius, Segments=Slider(9, range=3..20), FilletRadius=0)  # -> Polygon, Length
Z_2 = UnitZ(Factor=floor_thickness_2)
polygon_2 = Polygon(Plane=PlaneXY(0, 0, 0), Radius=ground_radius_2, Segments=Slider(3, range=3..20), FilletRadius=0)  # -> Polygon, Length
move = Move(Geometry=polygon.Polygon, Motion=Z)  # -> Geometry, Transform
Z_3 = UnitZ(Factor=hight)
polygon_3 = Polygon(Plane=pt, Radius=blob_radius, Segments=Slider(6, range=3..20), FilletRadius=0)  # -> Polygon, Length
move_2 = Move(Geometry=polygon_2.Polygon, Motion=Z_2)  # -> Geometry, Transform
Z_4 = UnitZ(Factor=hight_2)
scale = Scale(Geometry=move.Geometry, Center=Point(0, 0, 0), Factor=angle)  # -> Geometry, Transform
Z_5 = UnitZ(Factor=floor_thickness)
scale_2 = Scale(Geometry=move_2.Geometry, Center=Point(0, 0, 0), Factor=angle_2)  # -> Geometry, Transform
srf = Surface(move.Geometry)
move_3 = Move(Geometry=scale.Geometry, Motion=Z_3)  # -> Geometry, Transform
Z_6 = UnitZ(Factor=floor_thickness_2)
srf_2 = Surface(move_2.Geometry)
move_4 = Move(Geometry=scale_2.Geometry, Motion=Z_4)  # -> Geometry, Transform
rev = Reverse(Vector=Z_5)
rotate = Rotate(Geometry=move_3.Geometry, Angle=degrees(twist_angle), Plane=PlaneXY(0, 0, 0))  # -> Geometry, Transform
arrcurve = CurveArray(Geometry=polygon_3.Polygon, Curve=polygon_2.Polygon, Count=Slider(16, range=3..50))  # -> graft(Geometry), Transform
rev_2 = Reverse(Vector=Z_6)
rotate_2 = Rotate(Geometry=move_4.Geometry, Angle=degrees(twist_angle_2), Plane=PlaneXY(0, 0, 0))  # -> Geometry, Transform
extr = Extrude(Base=srf, Direction=rev)
extr_2 = Extrude(Base=srf_2, Direction=rev_2)
loft = Loft(
    Curves=[rotate.Geometry, move.Geometry],
    Options={Adjust=False, Closed=False, LoftEnds=0, LoftSimp=0, LoftType=0, Rebuild=10, Refit=0.01})
ccx = CurveCurve(CurveA=arrcurve.Geometry, CurveB=polygon_2.Polygon)  # -> Points, ParamsA, ParamsB
ccx_2 = CurveCurve(CurveA=arrcurve.Geometry, CurveB=polygon_2.Polygon)  # -> Points, ParamsA, ParamsB
loft_2 = Loft(
    Curves=[rotate_2.Geometry, polygon_2.Polygon],
    Options={Adjust=False, Closed=False, LoftEnds=0, LoftSimp=0, LoftType=0, Rebuild=10, Refit=0.01})
join = BrepJoin(Breps=[loft, extr])  # -> Breps, Closed
shatter = Shatter(Curve=arrcurve.Geometry, Parameters=ccx.ParamsA)
shatter_2 = Shatter(Curve=polygon_2.Polygon, Parameters=ccx_2.ParamsB)
dom = ConstructDomain(DomainStart=ccx_2.ParamsA, DomainEnd=ccx_2.ParamsB)
midpt = CurveMiddle(Curve=shatter_2)
midpt_2 = CurveMiddle(Curve=shatter)
midpt_3 = CurveMiddle(Curve=shatter_2)
subcrv = SubCurve(BaseCurve=polygon_2.Polygon, Domain=dom)
incurve = PointInCurve(Point=midpt_2, Curve=polygon_2.Polygon)  # -> reverse(Relationship), Point
incurve_2 = PointInCurve(Point=midpt_3, Curve=arrcurve.Geometry)  # -> Relationship, Point
crv = Curve(subcrv)
panel = Panel(dom)
rev_3 = ReverseList(List=incurve_2.Relationship)
cull = CullPattern(List=shatter, CullPattern=incurve.Relationship)
panel_2 = Panel(rev_3)
cull_2 = CullPattern(List=shatter_2, CullPattern=incurve_2.Relationship)
join_2 = JoinCurves(Curves=[cull, polygon_2.Polygon], Preserve=False)
panel_3 = Panel(incurve_2.Relationship)

# ==== cluster StarKim: This user object is based on HS_Kim script.
outer_radius = ClusterInput()
inner_radius = ClusterInput()
P = ClusterInput()
S = ClusterInput()
cir = Circle(Plane=P, Radius=outer_radius)
multiplication = Multiplication(A=S, B="2")
seam = Seam(Curve=reparameterize(cir), Seam="0")
deplane = DeconstructPlane(Plane=P)  # -> Origin, XAxis, YAxis, graft(ZAxis)
divide = DivideCurve(Curve=seam, Count=multiplication, Kinks=False)  # -> Points, Tangents, Parameters
xprod = CrossProduct(VectorA=deplane.ZAxis, VectorB=divide.Tangents, Unitize=False)  # -> Vector, Length
subtraction = Subtraction(A=outer_radius, B=inner_radius)
sift = SiftPattern(List=xprod.Vector, SiftPattern=[0, 1])  # -> Output0, Output1
sift_2 = SiftPattern(List=divide.Points, SiftPattern=[0, 1])  # -> Output0, Output1
amp = Amplitude(Vector=sift.Output1, Amplitude=subtraction)
move = Move(Geometry=sift_2.Output1, Motion=amp)  # -> Geometry, Transform
combine = CombineData(Input0=sift_2.Output0, Input1=move.Geometry)  # -> Result, Index
pline = PolyLine(Vertices=combine.Result, Closed=invert(False))
polyline = ClusterOutput(pline)
